# Dynamo custom node Analysis Period.dyf (Dynamo 1.0.0.1180)
# category: Ladybug.1|Analyze Weather Data
# Create a Ladybug Analysis Period

# group: load the script
code_block = CodeBlock { "analysisPeriod_node.py"; }

find_file_and_import_it = Python(IN[0]=code_block)
# ---------- find_file_and_import_it.python (34 lines) ----------
try:
	def getPackagePath(packageName):
		import sys
		sys.path.append('C:\Program Files (x86)\IronPython 2.7\Lib')
		import os
		import clr
		clr.AddReference('DynamoCore')
		_loc = clr.References[2].Location
		_ver = _loc.split('\\')[-2].split(' ')[-1]
		
		# the path structure has changed after the release of version 1
		dynamoPath_1 = "Dynamo\\Dynamo Revit\\" + _ver
		dynamoPath_0 = "Dynamo\\" + _ver
		appdata = os.getenv('APPDATA')
		path1 = r'%s\%s\packages\%s\extra\nodesrc\\'%(appdata, dynamoPath_1, packageName)
		path0 = r'%s\%s\packages\%s\extra\nodesrc\\'%(appdata, dynamoPath_0, packageName)
		
		if os.path.isdir(path1):
			return path1
		elif os.path.isdir(path0):
			return path0
		else:
			raise Exception("Can't find Dynamo installation Folder!")

	filePath = getPackagePath('Ladybug') + IN[0]

	with open(filePath, 'rb') as inf:
	    lines = inf.readlines()

	OUT = ''.join(lines)
except Exception, e:
	OUT = "ERROR: %s"%str(e) + \
		"\n\nIf you think this is a bug submit an issue on github.\n" + \
		"https://github.com/ladybug-analysis-tools/ladybug-dynamo/issues"
# ----------------------------------------
startMonth = Input(_startMonth_: int = 1)  # Start month (1-12)
startDay = Input(_startDay_: int = 1)  # Start day (1-31)
startHour = Input(_startHour_: int = 0)  # Start hour (0-23)
endMonth = Input(_endMonth_: int = 12)  # End month (1-12)
endDay = Input(_endDay_: int = 31)  # End day (1-31)
endHour = Input(_endHour_: int = 23)  # End hour (0-23)
timestep = Input(_timestep_: int = 1)  # An integer number from 1, 2, 3, 4, 5, 6, 10, 12, 15, 20, 30, 60
python_script_from_string = PythonStringNode(script=find_file_and_import_it, IN[0]=startMonth, IN[1]=startDay, IN[2]=startHour, IN[3]=endMonth, IN[4]=endDay, IN[5]=endHour, IN[6]=timestep)
code_block_2 = CodeBlock(out=python_script_from_string) { out[0]; out[1]; out[2]; }
analysisPeriod = Output(code_block_2.out0)  # Analysis period.
dates = Output(code_block_2.out1)  # List of dates in this analysis period.
hoursOfYear = Output(code_block_2.out2)  # List of hours of the year in this analysis period.
error_report = Python(IN[0]=find_file_and_import_it, IN[1]=python_script_from_string)
# ---------- error_report.python (15 lines) ----------
"""Report errors"""
importErr = IN[0]
runErr = IN[1]
errors = []

if importErr and str(importErr).startswith("ERROR:"):
	errors.append(importErr)

if runErr and str(runErr).startswith("ERROR:"):
	errors.append(runErr)

if len(errors)==0:
	OUT = "All good! Vvizzzz."
else:
	OUT = "\n".join(errors)
# ----------------------------------------
ERRReport = Output(error_report)  # Report.
