# Dynamo custom node Construct Location.dyf (Dynamo 1.0.0.1180)
# category: Ladybug.0|Ladybug
# Construct a Ladybug location based on input data

# group: load the script
code_block = CodeBlock { "constructLocation_node.py"; }

find_file_and_import_it = Python(IN[0]=code_block)
# ---------- find_file_and_import_it.python (34 lines) ----------
try:
	def getPackagePath(packageName):
		import sys
		sys.path.append('C:\Program Files (x86)\IronPython 2.7\Lib')
		import os
		import clr
		clr.AddReference('DynamoCore')
		_loc = clr.References[2].Location
		_ver = _loc.split('\\')[-2].split(' ')[-1]
		
		# the path structure has changed after the release of version 1
		dynamoPath_1 = "Dynamo\\Dynamo Revit\\" + _ver
		dynamoPath_0 = "Dynamo\\" + _ver
		appdata = os.getenv('APPDATA')
		path1 = r'%s\%s\packages\%s\extra\nodesrc\\'%(appdata, dynamoPath_1, packageName)
		path0 = r'%s\%s\packages\%s\extra\nodesrc\\'%(appdata, dynamoPath_0, packageName)
		
		if os.path.isdir(path1):
			return path1
		elif os.path.isdir(path0):
			return path0
		else:
			raise Exception("Can't find Dynamo installation Folder!")

	filePath = getPackagePath('Ladybug') + IN[0]

	with open(filePath, 'rb') as inf:
	    lines = inf.readlines()

	OUT = ''.join(lines)
except Exception, e:
	OUT = "ERROR: %s"%str(e) + \
		"\n\nIf you think this is a bug submit an issue on github.\n" + \
		"https://github.com/ladybug-analysis-tools/ladybug-dynamo/issues"
# ----------------------------------------
locationName = Input(_locationName_: string = "unknown city")  # A name for the location you are constructing. (ie. Steventon Island, Antarctica)
latitude = Input(_latitude_: double = 0.00)  # The latitude of the location you are constructing. Values must be between -90 and 90. Default is set to the equator
longitude = Input(_longitude_: double = 0.00)  # An optional numerical value representing the longitude of the location you are constructing. This can improve the accuracy of the resulting sun plot.
timeZone = Input(_timeZone_: double = 0.00)  # An optional integer representing the time zone of the location you are constructing. This can improve the accuracy of the resulting sun plot.  The time zone should follow the epw convention and should be between -12 and +12, where 0 is at Greenwich, UK, positive values are to the East of Greenwich and negative values are to the West.
elevation = Input(_elevation_: double = 0.00)  # An optional numerical value representing the elevation of the location you are constructing.
python_script_from_string = PythonStringNode(script=find_file_and_import_it, IN[0]=locationName, IN[1]=latitude, IN[2]=longitude, IN[3]=timeZone, IN[4]=elevation)
location = Output(python_script_from_string)  # Ladybug location. Use this input to draw a sunpath.
error_report = Python(IN[0]=find_file_and_import_it, IN[1]=python_script_from_string)
# ---------- error_report.python (15 lines) ----------
"""Report errors"""
importErr = IN[0]
runErr = IN[1]
errors = []

if importErr and str(importErr).startswith("ERROR:"):
	errors.append(importErr)

if runErr and str(runErr).startswith("ERROR:"):
	errors.append(runErr)

if len(errors)==0:
	OUT = "All good! Vvizzzz."
else:
	OUT = "\n".join(errors)
# ----------------------------------------
ERRReport = Output(error_report)  # Report
