# Dynamo custom node Deconstruct Location.dyf (Dynamo 1.0.0.1180)
# category: Ladybug.0|Ladybug
# Get different location data from a location string

# group: load the script
code_block = CodeBlock { "deconstructLocation_node.py"; }

find_file_and_import_it = Python(IN[0]=code_block)
# ---------- find_file_and_import_it.python (34 lines) ----------
try:
	def getPackagePath(packageName):
		import sys
		sys.path.append('C:\Program Files (x86)\IronPython 2.7\Lib')
		import os
		import clr
		clr.AddReference('DynamoCore')
		_loc = clr.References[2].Location
		_ver = _loc.split('\\')[-2].split(' ')[-1]
		
		# the path structure has changed after the release of version 1
		dynamoPath_1 = "Dynamo\\Dynamo Revit\\" + _ver
		dynamoPath_0 = "Dynamo\\" + _ver
		appdata = os.getenv('APPDATA')
		path1 = r'%s\%s\packages\%s\extra\nodesrc\\'%(appdata, dynamoPath_1, packageName)
		path0 = r'%s\%s\packages\%s\extra\nodesrc\\'%(appdata, dynamoPath_0, packageName)
		
		if os.path.isdir(path1):
			return path1
		elif os.path.isdir(path0):
			return path0
		else:
			raise Exception("Can't find Dynamo installation Folder!")

	filePath = getPackagePath('Ladybug') + IN[0]

	with open(filePath, 'rb') as inf:
	    lines = inf.readlines()

	OUT = ''.join(lines)
except Exception, e:
	OUT = "ERROR: %s"%str(e) + \
		"\n\nIf you think this is a bug submit an issue on github.\n" + \
		"https://github.com/ladybug-analysis-tools/ladybug-dynamo/issues"
# ----------------------------------------
location = Input(_location: var)  # The output from the importLocation, importEPW or constructLocation component. This is essentially a list of text summarizing a location on the earth.
python_script_from_string = PythonStringNode(script=find_file_and_import_it, IN[0]=location)
code_block_2 = CodeBlock(out=python_script_from_string) { out[0]; out[1]; out[2]; out[3]; out[4]; }
locationName = Output(code_block_2.out0)  # A name for the location you are constructing. (ie. Steventon Island, Antarctica)
latitude = Output(code_block_2.out1)  # The latitude of the location you are constructing. Values must be between -90 and 90. Default is set to the equator
longitude = Output(code_block_2.out2)  # An optional numerical value representing the longitude of the location you are constructing. This can improve the accuracy of the resulting sun plot.
timeZone = Output(code_block_2.out3)  # An optional integer representing the time zone of the location you are constructing. This can improve the accuracy of the resulting sun plot.  The time zone should follow the epw convention and should be between -12 and +12, where 0 is at Greenwich, UK, positive values are to the East of Greenwich and negative values are to the West.
elevation = Output(code_block_2.out4)  # An optional numerical value representing the elevation of the location you are constructing.
error_report = Python(IN[0]=find_file_and_import_it, IN[1]=python_script_from_string)
# ---------- error_report.python (15 lines) ----------
"""Report errors"""
importErr = IN[0]
runErr = IN[1]
errors = []

if importErr and str(importErr).startswith("ERROR:"):
	errors.append(importErr)

if runErr and str(runErr).startswith("ERROR:"):
	errors.append(runErr)

if len(errors)==0:
	OUT = "All good! Vvizzzz."
else:
	OUT = "\n".join(errors)
# ----------------------------------------
ERRReport = Output(error_report)
