# Dynamo custom node Import epw.dyf (Dynamo 1.0.0.1180)
# category: Ladybug.0|Ladybug
# Use this node to import lists of weather data into Dynamo from a standard .epw file.
# For detailed information about the structure of an epw file, you may want to read the
# "Weather Converter Program" section in "Auxiliary EnergyPlus Programs" document.
# All descriptions of importaed data are borrowed from this document.
# The document is available online at this address:
# "http://apps1.eere.energy.gov/buildings/energyplus/pdfs/auxiliaryprograms.pdf"

# group: load the script
code_block = CodeBlock { "importEPW_node.py"; }

find_file_and_import_it = Python(IN[0]=code_block)
# ---------- find_file_and_import_it.python (34 lines) ----------
try:
	def getPackagePath(packageName):
		import sys
		sys.path.append('C:\Program Files (x86)\IronPython 2.7\Lib')
		import os
		import clr
		clr.AddReference('DynamoCore')
		_loc = clr.References[2].Location
		_ver = _loc.split('\\')[-2].split(' ')[-1]
		
		# the path structure has changed after the release of version 1
		dynamoPath_1 = "Dynamo\\Dynamo Revit\\" + _ver
		dynamoPath_0 = "Dynamo\\" + _ver
		appdata = os.getenv('APPDATA')
		path1 = r'%s\%s\packages\%s\extra\nodesrc\\'%(appdata, dynamoPath_1, packageName)
		path0 = r'%s\%s\packages\%s\extra\nodesrc\\'%(appdata, dynamoPath_0, packageName)
		
		if os.path.isdir(path1):
			return path1
		elif os.path.isdir(path0):
			return path0
		else:
			raise Exception("Can't find Dynamo installation Folder!")

	filePath = getPackagePath('Ladybug') + IN[0]

	with open(filePath, 'rb') as inf:
	    lines = inf.readlines()

	OUT = ''.join(lines)
except Exception, e:
	OUT = "ERROR: %s"%str(e) + \
		"\n\nIf you think this is a bug submit an issue on github.\n" + \
		"https://github.com/ladybug-analysis-tools/ladybug-dynamo/issues"
# ----------------------------------------
epwFile = Input(_epwFile: string)  # File path to a valid epw file
analysisPeriod = Input(_analysisPeriod_: var = null)  # Ladybug Analysis Period
python_script_from_string = PythonStringNode(script=find_file_and_import_it, IN[0]=epwFile, IN[1]=analysisPeriod)
separate_outputs = CodeBlock(out=python_script_from_string)
# ---------- separate_outputs.designscript (16 lines) ----------
out[0];
out[1];
out[2];
out[3];
out[4];
out[5];
out[6];
out[7];
out[8];
out[9];
out[10];
out[11];
out[12];
out[13];
out[14];
out[15];
# ----------------------------------------
location = Output(separate_outputs.out0)  # A list of text summarizing the location data in the weather file (use this to construct the sun path).
Houlry_dry_bulb_temperature_in_C_Note_th = Output(separate_outputs.out1)  # "/* Houlry dry bulb temperature, in C. Note that this is a full numeric field (i.e. 23.6) and not an integer representation with tenths. Valid values range from 70 C to 70 C. Missing value for this field is 99.9. */ dryBulbTemperature"
Hourly_dew_point_temperature_in_C_Note_t = Output(separate_outputs.out2)  # "/* Hourly dew point temperature, in C. Note that this is a full numeric field (i.e. 23.6) and not an integer representation with tenths. Valid values range from 70 C to 70 C. Missing value for this field is 99.9. */ dewPointTemperature"
Hourly_Relative_Humidity_in_percent_Vali = Output(separate_outputs.out3)  # "/* Hourly Relative Humidity in percent. Valid values range from 0% to 110%. Missing value for this field is 999. */ relativeHumidity"
Hourly_Wind_Direction_in_degrees_where_t = Output(separate_outputs.out4)  # "/* Hourly Wind Direction in degrees where the convention is that North=0.0, East=90.0, South=180.0, West=270.0. (If wind is calm for the given hour, the direction equals zero.) Values can range from 0 to 360. Missing value is 999. */ windDirection"
This_is_the_hourly_wind_speed_in_m_sec_V = Output(separate_outputs.out5)  # "/*This is the hourly wind speed in m/sec. Values can range from 0 to 40. Missing value is 999.*/ windSpeed"
directNormalRadiation_Hourly_Direct_Norm = Output(separate_outputs.out6)  # "directNormalRadiation /* Hourly Direct Normal Radiation in Wh/m2. (Amount of solar radiation in Wh/m2 received directly from the solar disk on a surface perpendicular to the sun's rays, during the number of minutes preceding the time indicated.) If the field is missing ( 9999) or invalid (<0), it is set to 0. Counts of such missing values are totaled and presented at the end of the runperiod. */"
diffuseHorizontalRadiation_Hourly_Diffus = Output(separate_outputs.out7)  # "diffuseHorizontalRadiation /* Hourly Diffuse Horizontal Radiation in Wh/m2. (Amount of solar radiation in Wh/m2 received from the sky (excluding the solar disk) on a horizontal surface during the number of minutes preceding the time indicated.) If the field is missing ( 9999) or invalid (<0), it is set to 0. Counts of such missing values are totaled and presented at the end of the runperiod. */"
globalHorizontalRadiation_Hourly_Global_ = Output(separate_outputs.out8)  # "globalHorizontalRadiation /* Hourly Global Horizontal Radiation in Wh/m2. (Total amount of direct and diffuse solar radiation in Wh/m2 received on a horizontal surface during the number of minutes preceding the time indicated.) It is not currently used in EnergyPlus calculations. It should have a minimum value of 0; missing value for this field is 9999. */"
directNormalIlluminance_Hourly_Direct_No = Output(separate_outputs.out9)  # "directNormalIlluminance /* Hourly Direct Normal Illuminance in lux. (Average amount of illuminance in hundreds of lux received directly from the solar disk on a surface perpendicular to the sun's rays, during the number of minutes preceding the time indicated.) It is not currently used in EnergyPlus calculations. It should have a minimum value of 0; missing value for this field is 999999 and will be considered missing of >= 999900. */"
diffuseHorizontalIlluminance_Hourly_Diff = Output(separate_outputs.out10)  # "diffuseHorizontalIlluminance /* Hourly Diffuse Horizontal Illuminance in lux. (Average amount of illuminance in hundreds of lux received from the sky (excluding the solar disk) on a horizontal surface during the number of minutes preceding the time indicated.) It is not currently used in EnergyPlus calculations. It should have a minimum value of 0; missing value for this field is 999999 and will be considered missing of >= 999900. */"
globalHorizontalIlluminance_Hourly_Globa = Output(separate_outputs.out11)  # "globalHorizontalIlluminance /* Hourly Global Horizontal Illuminance in lux. (Average total amount of direct and diffuse illuminance in hundreds of lux received on a horizontal surface during the number of minutes preceding the time indicated.) It is not currently used in EnergyPlus calculations. It should have a minimum value of 0; missing value for this field is 999999 and will be considered missing of >= 999900. */"
liquidPrecipitationDepth_Amount_of_liqui = Output(separate_outputs.out13)  # "liquidPrecipitationDepth /* Amount of liquid precipitation(mm) observed at the indicated hour for the period indicated in the liquid precipitation quantity field. If this value is not missing, then it is used and overrides the precipitation flag as rainfall. Conversely, if the precipitation flag shows rain and this field is missing or zero, it is set to 1.5 (mm). */"
totalSkyCover_Fraction_for_total_sky_cov = Output(separate_outputs.out12)  # "totalSkyCover /* Fraction for total sky cover (tenths of coverage). (i.e. 1 is 1/10 covered. 10 is total coverage). (Amount of sky dome in tenths covered by clouds or obscuring phenomena at the hour indicated at the time indicated.) Minimum value is 0; maximum value is 10; missing value is 99. */"
barometricPressure_hourly_weather_statio = Output(separate_outputs.out14)  # "barometricPressure /* hourly weather station pressure in Pa. Valid values range from 31,000 to 120,000. Missing value for this field is 999999. */"
modelYear_The_year_from_which_the_hourly = Output(separate_outputs.out15)  # "modelYear /* The year from which the hourly data has been extracted. EPW files are synthesized from real recorded data from different years in a given climate. This is done to ensure that, for each month, the selected data is statistically representative of the average monthly conditions over the 18+ years of recording the data. Different EPW files will be synthesized from different years depeding on whether they are TMY (Typical Meteorological Year), TMY2, TMY3, AMY (Actual Meteorological Year) or other. */"
error_report = Python(IN[0]=find_file_and_import_it, IN[1]=python_script_from_string)
# ---------- error_report.python (15 lines) ----------
"""Report errors"""
importErr = IN[0]
runErr = IN[1]
errors = []

if importErr and str(importErr).startswith("ERROR:"):
	errors.append(importErr)

if runErr and str(runErr).startswith("ERROR:"):
	errors.append(runErr)

if len(errors)==0:
	OUT = "All good! Vvizzzz."
else:
	OUT = "\n".join(errors)
# ----------------------------------------
ERRReport = Output(error_report)  # Report
