# Dynamo custom node LB Color Range.dyf (Dynamo 1.0.0.1180)
# category: Ladybug.4|Extra
# A set of color ranges for coloring analysis results

# group: load the script
code_block = CodeBlock { "colorRange_node.py"; }

find_file_and_import_it = Python(IN[0]=code_block)
# ---------- find_file_and_import_it.python (34 lines) ----------
try:
	def getPackagePath(packageName):
		import sys
		sys.path.append('C:\Program Files (x86)\IronPython 2.7\Lib')
		import os
		import clr
		clr.AddReference('DynamoCore')
		_loc = clr.References[2].Location
		_ver = _loc.split('\\')[-2].split(' ')[-1]
		
		# the path structure has changed after the release of version 1
		dynamoPath_1 = "Dynamo\\Dynamo Revit\\" + _ver
		dynamoPath_0 = "Dynamo\\" + _ver
		appdata = os.getenv('APPDATA')
		path1 = r'%s\%s\packages\%s\extra\nodesrc\\'%(appdata, dynamoPath_1, packageName)
		path0 = r'%s\%s\packages\%s\extra\nodesrc\\'%(appdata, dynamoPath_0, packageName)
		
		if os.path.isdir(path1):
			return path1
		elif os.path.isdir(path0):
			return path0
		else:
			raise Exception("Can't find Dynamo installation Folder!")

	filePath = getPackagePath('Ladybug') + IN[0]

	with open(filePath, 'rb') as inf:
	    lines = inf.readlines()

	OUT = ''.join(lines)
except Exception, e:
	OUT = "ERROR: %s"%str(e) + \
		"\n\nIf you think this is a bug submit an issue on github.\n" + \
		"https://github.com/ladybug-analysis-tools/ladybug-dynamo/issues"
# ----------------------------------------
index = Input(_index_: double = 1)  # An index between 0-21 refering to one of the following possible gradients 0 - Orignal Ladybug 1 - Nuanced Ladybug 2 - Multi-colored Ladybug 3 - View Analysis 1 4 - View Analysis 2 (Red,Green,Blue) 5 - Sunlight Hours 6 - Ecotect 7 - Thermal Comfort Percentage 8 - Thermal Comfort Colors 9 - Thermal Comfort Colors (UTCI) 10 - Hot Hours 11 - Cold Hours 12 - Shade Benefit/Harm 13 - Thermal Comfort Colors v2 (UTCI) 14 - Shade Harm 15 - Shade Benefit 16 - Black to White 17 - CFD Colors 1 18 - CFD Colors 2 19 - Energy Balance 20 - THERM 21 - Cloud Cover
python_script_from_string = PythonStringNode(script=find_file_and_import_it, IN[0]=index)
colors = Output(python_script_from_string)  # List of colors
error_report = Python(IN[0]=find_file_and_import_it, IN[1]=python_script_from_string)
# ---------- error_report.python (15 lines) ----------
"""Report errors"""
importErr = IN[0]
runErr = IN[1]
errors = []

if importErr and str(importErr).startswith("ERROR:"):
	errors.append(importErr)

if runErr and str(runErr).startswith("ERROR:"):
	errors.append(runErr)

if len(errors)==0:
	OUT = "All good! Vvizzzz."
else:
	OUT = "\n".join(errors)
# ----------------------------------------
ERRReport = Output(error_report)  # Report
