# Dynamo custom node Solar Radiation Analysis.dyf (Dynamo 1.0.0.1180)
# category: Ladybug.3|Environmental Analysis
# Calculate solar radiation for points in wh

# group: load the script
code_block = CodeBlock { "solarRadiation_node.py"; }

find_file_and_import_it = Python(IN[0]=code_block)
# ---------- find_file_and_import_it.python (34 lines) ----------
try:
	def getPackagePath(packageName):
		import sys
		sys.path.append('C:\Program Files (x86)\IronPython 2.7\Lib')
		import os
		import clr
		clr.AddReference('DynamoCore')
		_loc = clr.References[2].Location
		_ver = _loc.split('\\')[-2].split(' ')[-1]
		
		# the path structure has changed after the release of version 1
		dynamoPath_1 = "Dynamo\\Dynamo Revit\\" + _ver
		dynamoPath_0 = "Dynamo\\" + _ver
		appdata = os.getenv('APPDATA')
		path1 = r'%s\%s\packages\%s\extra\nodesrc\\'%(appdata, dynamoPath_1, packageName)
		path0 = r'%s\%s\packages\%s\extra\nodesrc\\'%(appdata, dynamoPath_0, packageName)
		
		if os.path.isdir(path1):
			return path1
		elif os.path.isdir(path0):
			return path0
		else:
			raise Exception("Can't find Dynamo installation Folder!")

	filePath = getPackagePath('Ladybug') + IN[0]

	with open(filePath, 'rb') as inf:
	    lines = inf.readlines()

	OUT = ''.join(lines)
except Exception, e:
	OUT = "ERROR: %s"%str(e) + \
		"\n\nIf you think this is a bug submit an issue on github.\n" + \
		"https://github.com/ladybug-analysis-tools/ladybug-dynamo/issues"
# ----------------------------------------
testPoints = Input(_testPoints: var[]..[])  # Test points. You can use several methods including using Generate Test Points to generate test points.
pointsNormal = Input(_pointsNormal: var[]..[])  # Points Normal. A vector for each test point should be provided
geometries = Input(_geometries: var[]..[])  # All the context geometries as surfaces
filteredSkyMatrix = Input(_filteredSkyMatrix: System.Object)  # Ladybug Sky. Use Filter Sky Matrix node to generate a filtered sky
python_script_from_string = PythonStringNode(script=find_file_and_import_it, IN[0]=testPoints, IN[1]=pointsNormal, IN[2]=geometries, IN[3]=filteredSkyMatrix)
solarRadiation = Output(python_script_from_string)  # Radiation Values in wh
error_report = Python(IN[0]=find_file_and_import_it, IN[1]=python_script_from_string)
# ---------- error_report.python (15 lines) ----------
"""Report errors"""
importErr = IN[0]
runErr = IN[1]
errors = []

if importErr and str(importErr).startswith("ERROR:"):
	errors.append(importErr)

if runErr and str(runErr).startswith("ERROR:"):
	errors.append(runErr)

if len(errors)==0:
	OUT = "All good! Vvizzzz."
else:
	OUT = "\n".join(errors)
# ----------------------------------------
ERRReport = Output(error_report)  # Report
