# Dynamo custom node Sunpath.dyf (Dynamo 1.0.0.1180)
# category: Ladybug.2|Visualize Weather Data
# Use this node to make a 3D sun-path (aka. sun plot) in the Dynamo scene.  The node also outputs sun vectors that can be used for sunlight hours analysis or shading design with the other Ladybug nodes.

# group: load the script
code_block = CodeBlock { "sunpath_node.py"; }

find_file_and_import_it = Python(IN[0]=code_block)
# ---------- find_file_and_import_it.python (34 lines) ----------
try:
	def getPackagePath(packageName):
		import sys
		sys.path.append('C:\Program Files (x86)\IronPython 2.7\Lib')
		import os
		import clr
		clr.AddReference('DynamoCore')
		_loc = clr.References[2].Location
		_ver = _loc.split('\\')[-2].split(' ')[-1]
		
		# the path structure has changed after the release of version 1
		dynamoPath_1 = "Dynamo\\Dynamo Revit\\" + _ver
		dynamoPath_0 = "Dynamo\\" + _ver
		appdata = os.getenv('APPDATA')
		path1 = r'%s\%s\packages\%s\extra\nodesrc\\'%(appdata, dynamoPath_1, packageName)
		path0 = r'%s\%s\packages\%s\extra\nodesrc\\'%(appdata, dynamoPath_0, packageName)
		
		if os.path.isdir(path1):
			return path1
		elif os.path.isdir(path0):
			return path0
		else:
			raise Exception("Can't find Dynamo installation Folder!")

	filePath = getPackagePath('Ladybug') + IN[0]

	with open(filePath, 'rb') as inf:
	    lines = inf.readlines()

	OUT = ''.join(lines)
except Exception, e:
	OUT = "ERROR: %s"%str(e) + \
		"\n\nIf you think this is a bug submit an issue on github.\n" + \
		"https://github.com/ladybug-analysis-tools/ladybug-dynamo/issues"
# ----------------------------------------
Input_a_number_between_0_and_360_It_repr = Input(/* Input a number between 0 and 360 It represents the degrees off from the y-axis to make North. The default North direction is set to the Y-axis (0 degrees). */ north_: double = 0)
The_output_from_the_importEPW_or_constru = Input(/* The output from the importEPW or constructLocation component. This is essentially a list of text summarizing a location on the earth. */ _location: var)
A_list_or_a_single_number_that_respresen = Input(/* A list or a single number that respresent an hour of the year. Use Analysis Period or HOY nodes to generate the numbers. */ _hoursOfYear_: var[]..[] = {12})
Input_a_point_here_to_change_the_locatio = Input(/* Input a point here to change the location of the sun path. The default is set to the Dynamo model origin (0,0,0). */ _centerPt_: Autodesk.Geometry.Point = Autodesk.Geometry.Point.Origin())
Input_a_number_here_to_change_the_scale_ = Input(/* Input a number here to change the scale of the sun path. The default is set to 1. */ _scale_: double = 1)
sunScale = Input(_sunScale_: double = 1)  # Input a number here to change the scale of the sun spheres located along the sun path.  The default is set to 1.
annualSunpath = Input(_annualSunpath_: bool = true)  # By default, this value is set to "True" (or 1) which will produce a sun path for the whole year. Set this input to "False" (or 0) to generate a sun path for just one day of the year (or several days if multiple days are included in the analysis period).
python_script_from_string = PythonStringNode(script=find_file_and_import_it, IN[0]=Input_a_number_between_0_and_360_It_repr, IN[1]=The_output_from_the_importEPW_or_constru, IN[2]=A_list_or_a_single_number_that_respresen, IN[3]=Input_a_point_here_to_change_the_locatio, IN[4]=Input_a_number_here_to_change_the_scale_, IN[5]=sunScale, IN[6]=annualSunpath)
code_block_2 = CodeBlock(out=python_script_from_string) { out[0]; out[1]; out[2]; out[3]; out[4]; out[5]; out[6]; out[7]; }
sunVectors = Output(code_block_2.out0)  # List of sun vectors
sunAltitudes = Output(code_block_2.out1)  # List of sun altitudes
sunAzimuths = Output(code_block_2.out2)  # List of sun azimuths
sunSpheres = Output(code_block_2.out3)  # List of sun geometries as spheres
geometry = Output(code_block_2.out4)  # Sun path geometry
centerPt = Output(code_block_2.out5)  # Sun path center-point
sunPositions = Output(code_block_2.out6)  # Sun positions as a list of Points
datetimes = Output(code_block_2.out7)  # List of date and time info for each sun position
error_report = Python(IN[0]=find_file_and_import_it, IN[1]=python_script_from_string)
# ---------- error_report.python (15 lines) ----------
"""Report errors"""
importErr = IN[0]
runErr = IN[1]
errors = []

if importErr and str(importErr).startswith("ERROR:"):
	errors.append(importErr)

if runErr and str(runErr).startswith("ERROR:"):
	errors.append(runErr)

if len(errors)==0:
	OUT = "All good! Vvizzzz."
else:
	OUT = "\n".join(errors)
# ----------------------------------------
ERRReport = Output(error_report)  # Report
