# Dynamo graph 00_importEpw.dyn (Dynamo 1.3.0.875)

# group: Select an epw weather file. If you don't have any epw files you can download one from epwmap: http://ladybug.tools/epwmap/
file_path = Filename("..\..\..\..\..\..\..\..\EnergyPlusV8-6-0\WeatherData\USA_CA_San.Francisco.Intl.AP.724940_TMY3.epw")

import_epw = Custom[Import EPW](epwFile=file_path)  # Import epw. -
watch = Watch(import_epw.ERRReport)
import_location = Custom[Import Location](epwFile=file_path)  # Import location data from an epw weather file
deconstruct_location = Custom[Deconstruct Location](location=import_location.location)  # Get different location data from a location string
construct_location = Custom[Construct Location](name=deconstruct_location.name, latitude=deconstruct_location.latitude, longitude=deconstruct_location.longitude, timeZone=deconstruct_location.timeZone, elevation=deconstruct_location.elevation)  # Construct a Ladybug location based on input data
watch_2 = Watch(construct_location.location)
watch_3 = Watch(import_epw.location)
watch_4 = Watch(import_epw.windSpeed)
analysis_period = Custom[Analysis Period]()  # Analysis Period. -
watch_5 = Watch(analysis_period.dates)
