# Dynamo graph 01_sunpath.dyn (Dynamo 1.3.0.875)

north_angle_from_yaxis = CodeBlock { 0; }
file_path = Filename("..\..\..\..\..\..\..\..\EnergyPlusV8-6-0\WeatherData\USA_CA_San.Francisco.Intl.AP.724940_TMY3.epw")

# group: Import location from an epw weather file. You can create a location from scratch if you don't have access to an epw file.
import_location = Custom[Import Location](epwFile=file_path)  # Import location data from an epw weather file

month = DoubleSlider(8, range=1..12 step 1)
code_block = CodeBlock { 6..20; }

# group: Calculate HOY
calculate_hoy = Custom[Calculate HOY](month=month, hour=code_block)  # Calculate hour of year for a month, day and hour

boolean = BoolSelector(true)
sunPath = Custom[SunPath](north=north_angle_from_yaxis, location=import_location.location, hoys=calculate_hoy.hoy, annual=boolean)  # Use this component to make a 3D sun-path (aka. sun plot). The component also outputs sun vectors that can be used for solar access analysis or shading design. -
byStartPointEndPoint = Line.ByStartPointEndPoint(startPoint=sunPath.sunPts, endPoint=sunPath.centerPt)
change_the_scale = CodeBlock { 0.5; }
HOY = DoubleSlider(8, range=1..24 step 1)
watch = Watch(sunPath.ERRReport)
watch_2 = Watch(calculate_hoy.date)
watch_3 = Watch(sunPath.vectors)
